# Grasshopper definition main.gh (Grasshopper 1.0.7)
# Copyright: © Timo Harboe ApS

# ---- group: click to auto-update all referenced clusters
update_referenced_clusters = GhPythonScript(trigger=Button())
# ---------- update_referenced_clusters: Python ----------
__author__ = "Serjoscha Duering"
__version__ = "2023.09.06"

import rhinoscriptsyntax as rs
import Grasshopper as gh
from Grasshopper.Kernel.Special import GH_Cluster

if trigger:
    # auto  update all clusters 
    activeDoc = gh.Instances.ActiveCanvas.Document
    mainObjects = activeDoc.Objects
    for obj in mainObjects:
        if isinstance(obj, gh.Kernel.Special.GH_Cluster):
            try:
                obj.ReadGhClusterFile(obj.FilePath  )
            except:
                pass
# ---------- end update_referenced_clusters ----------

# ----
geometry = Geometry(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)

# ---- group: referenced from "VolumeGenerator"
cluster = Cluster_2(linegeo=geometry)

# ---- group: referenced from "utils"
pointcounter = PointCount(list=cluster)

# ==== cluster Cluster_2
linegeo = ClusterInput()
cluster = Cluster(linegeo=linegeo)  # -> points, length
panel = Panel("dummy things")
cluster_2 = Cluster(linegeo=cluster.points)  # -> points, length
points = ClusterOutput(cluster.points)

# ==== cluster Cluster
linegeo = ClusterInput()
number_slider = Slider(0, range=0..10)
linegeo_2 = Data(linegeo)
divide_curve = DivideCurve(Curve=linegeo_2, Count=Slider(12, range=0..20), Kinks=False)  # -> Points, Tangents, Parameters
pointcount = PointCount(list=divide_curve.Points)
length = ClusterOutput(pointcount)
points = ClusterOutput(divide_curve.Points)

# ==== cluster PointCount
list = ClusterInput()
panel = Panel("/ahahaha")
list_length = ListLength(List=list)
length = ClusterOutput(list_length)
